# Grasshopper definition serial.gh (Grasshopper 1.0.8)
# plug-ins: CRFT Tools

list = SerialPorts({"cu.debug-console", "cu.JBLRACETWS", "cu.Bluetooth-Incoming-Port", "cu.usbserial-130"}, selected="cu.usbserial-130")
serial_control = SerialControl(
    Port=list,
    BaudRate=115200,
    Connect=False,
    Start=False,
    Pause=False,
    Resume=False,
    Stop=False,
    SendCommand=False,
    Home=Button())  # -> Connected, Printing, Paused, Response, Status, PortEvent
panel = Panel(serial_control.PortEvent)
