# Grasshopper definition plugin_tests.gh (Grasshopper 1.0.8)
# plug-ins: CRFT Tools

boolean_toggle = BooleanToggle(True)
file_path = FilePath("/Users/jorgemuyo/Desktop/crft/backup/porcelain.mp4")
button = Button()
boolean_toggle_2 = BooleanToggle(True)
sam_ui = SAMUI(VideoPath=file_path, FrameRate=Slider(1, range=0..1), Run=False, Preserve=Toggle(True))  # -> Status, OutputPath, Points
webcam = Webcam(Enable=False, Device=Slider(0, range=0..1))  # -> Image, RecordingPath
panel = Panel("/tmp/frames_porcelain/reconstruction/model.ply")
panel_2 = Panel(sam_ui.OutputPath)
ply_importer = PLYImporter(Import=True)  # -> Mesh, Vertices, Colors
